# Grasshopper definition 02_branch_overview.ghx (Grasshopper 1.0.8)
# plug-ins: Pufferfish

# ----
# Load obj files your data folder
# and create Mesh
# - set the boolean toggle to true
# - this may take up to a minute
boolean_toggle = BooleanToggle(False)
loadmesh = Python3Script(load_mesh=boolean_toggle)  # -> out, mesh, ID; inputs load_mesh: Boolean
# ---------- loadmesh: Python ----------
#! python 3
# venv: foc26_utc

#locate file in the same folder
from compas_rhino import unload_modules
import sys
import os

#get current file path
path = ghenv.Component.OnPingDocument().FilePath
print (path)
#get parent directory of the parent directory
parentdir = os.path.dirname(path)
print (parentdir)
#get src folder which contains classes
dire = os.path.join(parentdir,'src')
print (dire)

sys.path.append(dire)

unload_modules('mesh_utils')

from mesh_utils import load_branch_meshes


if load_mesh:
    mesh, ID = load_branch_meshes()
# ---------- end loadmesh ----------

# ----
# Pre-process
# - press the play button
# - this may take up to 2 minutes
data_dam = DataDam(DataDataA=loadmesh.mesh, DataA=loadmesh.ID, BufferDelay=10000000, BufferMode=0)  # -> DataDataA, DataDataB
repair = Python3Script(mesh=data_dam.DataDataA)  # -> out, mesh_out; inputs mesh: list
# ---------- repair: Python ----------
#! python 3
# venv: foc26_utc

#locate file in the same folder
from compas_rhino import unload_modules
import sys
import os

#get current file path
path = ghenv.Component.OnPingDocument().FilePath
print (path)
#get parent directory of the parent directory
parentdir = os.path.dirname(path)
print (parentdir)
#get src folder which contains classes
dire = os.path.join(parentdir,'src')
print (dire)

sys.path.append(dire)

unload_modules('mesh_utils')

from mesh_utils import load_branch_meshes
import pymeshfix
from compas.datastructures import Mesh
import numpy as np
from compas_cgal.meshing import trimesh_remesh

mesh_cgal = [trimesh_remesh(mesh_in.to_vertices_and_faces(triangulated=True), 10.0) for mesh_in in mesh]

mesh_cgal = [Mesh.from_vertices_and_faces(*m) for m in mesh_cgal]

mesh_out = []
for m in mesh_cgal:
    vertices, faces = m.to_vertices_and_faces(triangulated=True)

    vertices = np.asarray(vertices, dtype=np.float64)
    faces = np.asarray(faces, dtype=np.int32)

    mf = pymeshfix.MeshFix(vertices, faces)

    # main repair routine
    mf.repair(
        verbose=True,
        joincomp=True,
        remove_smallest_components=True,
    )

    vclean = mf.v
    fclean = mf.f

    mesh_out.append(Mesh.from_vertices_and_faces(vclean, fclean))
# ---------- end repair ----------
preprocess = Python3Script(mesh=repair.mesh_out)  # -> out, mesh_origin, bounding_box, is_fork, angle; inputs mesh: list
# ---------- preprocess: Python ----------
#! python 3
# venv: foc26_utc_test

#locate file in the same folder
from compas_rhino import unload_modules
from compas_rhino.conversions import mesh_to_compas, vector_to_rhino, point_to_rhino
import sys
import os

import compas_cgal

print(compas_cgal.__version__)

#get current file path
path = ghenv.Component.OnPingDocument().FilePath
print (path)
#get parent directory of the parent directory
parentdir = os.path.dirname(path)
print (parentdir)
#get src folder which contains classes
dire = os.path.join(parentdir,'src')
print (dire)

sys.path.append(dire)

unload_modules('branch')
unload_modules('mesh_utils')
unload_modules('graph_utils')
unload_modules('centerline')


from branch import Branch
import mesh_utils
import graph_utils

from compas.geometry import Polyline, Line

mesh_origin = []
angle = []
for m in mesh:

    branch = Branch(m)
    branch.preprocess()
    mesh_origin.append(branch.mesh)
    bifurcation_angle = branch.skeleton_bifurcation_angle() if branch.is_bifurcation else None
    angle.append(bifurcation_angle)
# ---------- end preprocess ----------
compas_draw = COMPASDraw(cg=preprocess.mesh_origin)  # -> rg
#   port cg: The COMPAS geometry or datastructure to be drawn.
#   port rg: The Rhino geometry object.
# ---------- compas_draw: Python ----------
# r: compas>=2.8.1
"""
Draws COMPAS geometry in Grasshopper.
"""

from typing import Any

import Grasshopper

from compas.scene import SceneObject


class CompasToRhinoGeometry(Grasshopper.Kernel.GH_ScriptInstance):
    def RunScript(self, cg):
        if not cg:
            return None

        return SceneObject(item=cg).draw()
# ---------- end compas_draw ----------

grid_size = Slider(10, range=0..10)
distance = Slider(800, range=0..1000)

# ----
# Arrange
# - create layout for branches
xz_plane = XZPlane(Origin=Point(0, 0, 0))
sort_list = SortList(Keys=preprocess.angle, ValuesValuesA=compas_draw, ValuesValuesB=data_dam.DataDataB)  # -> Keys, ValuesValuesA, ValuesValuesB
rectangular = Rectangular(Plane=xz_plane, SizeX=distance, SizeY=distance, ExtentX=grid_size, ExtentY=grid_size)  # -> Cells, Points
list_length = ListLength(List=compas_draw)
point = Point(flatten(rectangular.Points))
series = Series(Start=0, Step=1, Count=list_length)
area = Area(Geometry=sort_list.ValuesValuesA)  # -> Area, Centroid
list_item = ListItem(List=point, Index=series, Wrap=True)
move_to_point = MoveToPoint(Geometry=sort_list.ValuesValuesA, PointA=area.Centroid, PointB=list_item)  # -> Moved, Vector, Transform

# ----
# Color
bounds = Bounds(Numbers=preprocess.angle)
deconstruct_domain = DeconstructDomain(Domain=bounds)  # -> Start, End
gradient = Gradient(
    LowerLimit=deconstruct_domain.Start,
    UpperLimit=deconstruct_domain.End,
    Parameter=sort_list.Keys,
    stops=[0: RGB(0, 98, 0), 0.25: RGB(81, 175, 17), 0.5: RGB(159, 198, 146), 0.75: RGB(170, 235, 41), 1: RGB(221, 255, 53)])
mesh = Mesh(move_to_point.Moved)
custom_preview = CustomPreview(Geometry=mesh, Material=gradient)

# ----
# Branch ID
multiplication = Multiplication(A=distance, B=0.5)
subtraction = Subtraction(A=distance, B=multiplication)
unit_z = UnitZ(Factor=expr("x*-1", subtraction))
addition = Addition(A=move_to_point.Vector, B=unit_z)
text_tag = TextTag(Location=addition, Text=sort_list.ValuesValuesB, Colour=ColourSwatch(SwatchColor=RGB(0, 93, 255)))
